# Dynamo graph Location_R23.dyn (Dynamo 2.16.1.2727)
# packages: Orchid 216.3.0.5828

# group: Project phase
# File: defaultProject
phases = Phase("New Construction")  # graph input
watch = Watch(phases)

# group: Project location
project_locations = ProjectLocation("Internal")  # graph input
getVector = Orchid.RevitProject.Common.Location.GetVector(location=project_locations)
watch_2 = Watch(getVector)
current = Orchid.RevitProject.Common.Location.Current()
watch_3 = Watch(current)
name = Element.Name(element=current)
watch_4 = Watch(name)
getPoint = Orchid.RevitProject.Common.Location.GetPoint(location=project_locations)
watch_5 = Watch(getPoint)
set = Orchid.RevitProject.Common.Location.Set(location=project_locations)
watch_6 = Watch(set)
