# Dynamo graph Open View.dyn (Dynamo 2.3.1.11775)
# packages: Orchid 203.3.0.8042

views = Views("{3D}")  # graph input
openView = Orchid.RevitProject.Common.Document.OpenView(view=views)
watch = Watch(openView)
