# Dynamo graph PDFexport_R22.dyn (Dynamo 2.12.1.8246)
# packages: Orchid 212.4.0.5820, Orchid 2.12.5.6169

# group: Merge PDF files
code_block = CodeBlock()
# ---------- code_block.designscript (6 lines) ----------
//input documents
["%userprofile%\\Downloads\\PDF\\pdf1.pdf",
"%userprofile%\\Downloads\\PDF\\pdf2.pdf"];

//output file path
"%userprofile%\\Downloads\\PDF\\result.pdf";
# ----------------------------------------
o_file_mergepdf = Orchid.Common.File.MergePDF(documents=code_block.out0, filePath=code_block.out1)  # frozen

o_pdfexport_papersize = Orchid.Common.PDFexport.PaperSize()
watch = Watch(o_pdfexport_papersize)

# group: Remove print setting
string = StringInput("testSetting")  # graph input
o_pdfexport_byname = Orchid.Common.PDFexport.ByName(name=string)
o_pdfexport_deletesetting = Orchid.Common.PDFexport.DeleteSetting(exportSetting=o_pdfexport_byname)  # frozen
o_export_setting = Setting("testSetting")
watch_2 = Watch(o_pdfexport_byname)

# group: Export to PDF
o_sheet_set = SheetSet("A3 set")  # graph input
boolean = BoolSelector(false)  # graph input
o_document_name = Orchid.RevitProject.Common.Document.Name()
o_pdfexport_quality = ExportQuality("DPI1200")
o_pdfexport_byviewsheetset = Orchid.Common.PDFexport.ByViewSheetSet(viewSheetSet=o_sheet_set, combine=boolean, fileName=o_document_name, exportQuality=o_pdfexport_quality)
o_sheetset_getview = Orchid.RevitProject.Views.SheetSet.GetView(viewSheetSet=o_sheet_set)
o_pdfexport_byview = Orchid.Common.PDFexport.ByView(view=o_sheetset_getview, combine=boolean, fileName=o_document_name)  # frozen

string_2 = StringInput("testSetting")  # graph input
o_pdfexport_createsetting = Orchid.Common.PDFexport.CreateSetting(name=string_2)
o_pdfexport_papersizes = PaperSize("ISO A3 : 297x420 mm")
o_print_pageorientation = PageOrientation("Portrait")  # graph input
o_print_paperplacement = PaperPlacement("Lower Left")  # graph input
o_print_margintype = MarginType("User defined")  # graph input
code_block_2 = CodeBlock { [10,10]; }
o_print_zoomtype = ZoomType("Zoom")  # graph input
code_block_3 = CodeBlock { 100; }
o_pdfexport_changesetting = Orchid.Common.PDFexport.ChangeSetting(exportSetting=o_pdfexport_createsetting, paperZize=o_pdfexport_papersizes, pageOrientation=o_print_pageorientation, paperPlacement=o_print_paperplacement, marginType=o_print_margintype, margin=code_block_2, zoomType=o_print_zoomtype, zoom=code_block_3)  # frozen

# group: SheetSet
code_block_4 = CodeBlock { "Sheets"; }  # frozen
byName = Category.ByName(name=code_block_4)
all_elements_of_category = ElementsOfCategory(Category=byName)
string_3 = StringInput("testSet")  # graph input
o_sheetset_create = Orchid.RevitProject.Views.SheetSet.Create(view=all_elements_of_category, name=string_3)
o_sheetset_delete = Orchid.RevitProject.Views.SheetSet.Delete(viewSheetSet=o_sheetset_create)
o_sheetset_getview_2 = Orchid.RevitProject.Views.SheetSet.GetView(viewSheetSet=o_sheetset_create)
o_sheet_set_2 = SheetSet("A3 set")  # graph input
o_sheetset_change = Orchid.RevitProject.Views.SheetSet.Change(view=o_sheetset_getview_2, viewSheetSet=o_sheet_set_2)

# group: Print current view (center and fit to page)
string_4 = StringInput("testSetting2")  # graph input; frozen
o_pdfexport_papersizes_2 = PaperSize("ISO A3 : 297x420 mm")
o_print_paperplacement_2 = PaperPlacement("Center")  # graph input
o_print_zoomtype_2 = ZoomType("Fit To Page")  # graph input
o_pdfexport_createsetting_2 = Orchid.Common.PDFexport.CreateSetting(name=string_4, paperZize=o_pdfexport_papersizes_2, paperPlacement=o_print_paperplacement_2, zoomType=o_print_zoomtype_2)
o_document_activeview = Orchid.RevitProject.Common.Document.ActiveView()
o_pdfexport_byview_2 = Orchid.Common.PDFexport.ByView(pathName=o_document_activeview, exportSetting=o_pdfexport_createsetting_2)
# note: if export options there are rarely set need to be included, then connect:
# "Export.SetOptions" output ExportSetting to "Export.ByView" input exportSetting!
o_datastream_await = Orchid.Common.DataStream.Await(pass=o_pdfexport_createsetting_2, waitFor=o_pdfexport_byview_2)
o_pdfexport_deletesetting_2 = Orchid.Common.PDFexport.DeleteSetting(exportSetting=o_datastream_await)

# group: Print options there are rarely set
boolean_2 = BoolSelector(true)  # graph input
boolean_3 = BoolSelector(false)  # graph input
o_print_rasterquality = RasterQuality("Medium")
o_print_colordepth = ColorDepthType("Gray Scale")  # graph input
o_pdfexport_setoptions = Orchid.Common.PDFexport.SetOptions(exportSetting=o_pdfexport_createsetting_2, viewLinksinBlue=boolean_2, hideReforWorkPlanes=boolean_3, hideUnreferencedViewTags=boolean_2, maskCoincidentLines=boolean_2, hideScopeBoxes=boolean_3, hideCropBoundaries=boolean_3, replaceHalftoneWithThinLines=boolean_2, createOutputUsing=boolean_2, rasterQuality=o_print_rasterquality, colorDepth=o_print_colordepth)  # frozen
