# Dynamo graph Scheduling_R22.dyn (Dynamo 2.12.1.8246)
# packages: Orchid 212.4.0.5819

# group: Add shared parameter
code_block = CodeBlock()
# ---------- code_block.designscript (6 lines) ----------
//Parameter name
"ProductID";
//SP Parameter group
"DTU_Facility";
//Parameter group
"PG_ADSK_MODEL_PROPERTIES";
# ----------------------------------------
o_sharedparameter_add = Orchid.RevitProject.Parameters.SharedParameter.Add(parameterName=code_block.out0, groupName=code_block.out1, group=code_block.out2)

# group: Create Schedules
code_block_2 = CodeBlock()
# ---------- code_block_2.designscript (7 lines) ----------
[
"Ceilings",
"Doors",
"Floors",
"Windows",
"Walls"
];
# ----------------------------------------
byName = Category.ByName(name=code_block_2)
code_block_3 = CodeBlock(category=byName) { t = category; t+" Shedule"; "RegularSchedule"; }
createSchedule = ScheduleView.CreateSchedule(category=code_block_3.t, name=code_block_3.out1, scheduleType=code_block_3.out2)
o_datastream_await = Orchid.Common.DataStream.Await(pass=createSchedule, waitFor=o_sharedparameter_add)
schedulableFields = ScheduleView.SchedulableFields(scheduleView=o_datastream_await)
code_block_4 = CodeBlock()
# ---------- code_block_4.designscript (9 lines) ----------
[
"ProductID",
"Type",
"Count",

// these are not avalible
// in all schedules!
"Level",
"Base Constraint"];
# ----------------------------------------
o_schedulablefield_byname = Orchid.RevitProject.Schedules.SchedulableField.ByName(schedulableField=schedulableFields@L2, name=code_block_4)
o_list_clean = Orchid.Common.List.Clean(list=o_schedulablefield_byname)
addFields = ScheduleView.AddFields(scheduleView=createSchedule@L1, fields=o_list_clean@L2)

# group: Set the schedule
o_schedule_footer_type = ScheduleFooterType("Totals")
code_block_5 = CodeBlock()
# ---------- code_block_5.designscript (8 lines) ----------
["ProductID","Type"];
// footer
"ScheduleFooter";
["Totals","None"];
// blankLine
[true,false];
"Totals";
true;
# ----------------------------------------
o_orchid_enumbyname = Orchid.Common.Orchid.EnumByName(enumType=code_block_5.out1, valueName=code_block_5.out2)
o_orchid_enumbyname_2 = Orchid.Common.Orchid.EnumByName(enumType=code_block_5.out1, valueName=code_block_5.out4)
o_schedule_sortinggrouping = Orchid.RevitProject.Schedules.Schedule.SortingGrouping(scheduleView=addFields, name=code_block_5.out0, footer=o_orchid_enumbyname, blankLine=code_block_5.out3, grandTotals=o_orchid_enumbyname_2, itemize=code_block_5.out5)
o_schedule_sort_order = ScheduleSortOrder("Ascending")

# group: Format the schedule
o_schedule_field_display_type = ScheduleFieldDisplayType("Totals")
code_block_6 = CodeBlock { "Count"; "ScheduleHorizontalAlignment"; "Right"; "ScheduleFieldDisplayType"; "Totals"; }
o_revit_enumbyname = Orchid.AdeskApp.Revit.EnumByName(enumType=code_block_6.out1, valueName=code_block_6.out2)
o_revit_enumbyname_2 = Orchid.AdeskApp.Revit.EnumByName(enumType=code_block_6.out3, valueName=code_block_6.out4)
o_schedule_formatting = Orchid.RevitProject.Schedules.Schedule.Formatting(scheduleView=o_schedule_sortinggrouping, name=code_block_6.out0, horizontalAlignment=o_revit_enumbyname, calculate=o_revit_enumbyname_2)
o_horizontal_alignment_style = HorizontalAlignmentStyle("Right")
o_schedule_heading_orientations = ScheduleHeadingOrientation("Horizontal")

# group: Selection
code_block_7 = CodeBlock { "Model"; "Annotation"; "AnalyticalModel"; "Internal"; }
o_element_bycategorytype = Orchid.RevitProject.Elements.Element.ByCategoryType(categoryType=code_block_7.out0)
watch = Watch(o_element_bycategorytype.Category)
o_clipboard_copyto = Orchid.Common.Clipboard.CopyTo(object=o_element_bycategorytype.Category)
